# Grasshopper definition image_sampling.gh (Grasshopper 1.0.7)
# plug-ins: Kangaroo2 Components, OpenNest, Sasquatch, LunchBox

curve = Curve([<curve referenced from the Rhino model> x6])
curve_to_polyline = CurveToPolyline(Curve=curve, ToleranceDistance=5, ToleranceAngle=0)  # -> Polyline, Segments
surface = Surface(<surface referenced from the Rhino model>)
number_slider = Slider(58, range=0..100)  # disabled
number_slider_2 = Slider(79, range=0..100)  # disabled
brep_edges = BrepEdges(Brep=surface)  # -> Naked, Interior, NonManifold
boolean_toggle = BooleanToggle(False)  # disabled
surface_split = SurfaceSplit(Surface=surface, Curves=curve_to_polyline.Polyline)  # -> flatten(Fragments)
button = Button()  # disabled
button_2 = Button()  # disabled
surface_2 = Surface([<surface referenced from the Rhino model> x3])
join_curves = JoinCurves(Curves=brep_edges.Naked, Preserve=False)
curve_2 = Curve(<curve referenced from the Rhino model>)
boundary_surfaces = BoundarySurfaces(Edges=curve_2)
duplicate_data = DuplicateData(Data=boundary_surfaces, Number=Slider(87, range=0..100), Order=True)  # -> flatten(Data)
brep_edges_2 = BrepEdges(Brep=surface_split)  # -> Naked, Interior, NonManifold
surface_border = SurfaceBorder(Surface=surface_split)  # -> flatten(OuterBorder), InnterBorder; disabled
surface_3 = Surface(join_curves)

number_slider_3 = Slider(20, range=1..100)
number_slider_4 = Slider(77, range=1..100)
value_list = ValueList({"hexagonal": 0, "diamond": 1, "rectangle": 2, "triangle": 3}, selected="rectangle")

divide_surface = DivideSurface(Surface=surface, UCount=Slider(57, range=0..100), VCount=Slider(53, range=0..100))  # -> Points, Normals, Parameters
graft_tree = GraftTree(Tree=surface_border.OuterBorder, IncludeEmptyLists=True, IncludeNullItems=True)  # -> simplify(Tree); disabled
opennest = OpenNest(
    Sheets=surface_2,
    Geo=duplicate_data,
    Spacing=1,
    Placement=4,
    Tolerance=0.1,
    Rotations=4,
    Iterations=number_slider_2,
    Seed=number_slider,
    Reset=button_2,
    Run=button)  # -> Sheets, Geo, ID, Transform, IDS; disabled
stream_gate = StreamGate(Stream=surface, Gate=value_list)  # -> Target0, Target1, Target2, Target3
number_slider_5 = Slider(0, range=0..100)  # disabled
number_slider_6 = Slider(250, range=100..500)  # disabled
image_sampler = ImageSampler(
    surface,
    FilePath="C:\Users\ewama\Documents\GitHub\hgh\img\mozaika_kwantyzacja_ps.png",
    Filter="Colour",
    Interpolate=False,
    Umax=1984,
    Umin=1,
    Vmax=1546,
    Vmin=1,
    Wrap=1)
join_curves_2 = JoinCurves(Curves=brep_edges_2.Naked, Preserve=False)  # -> flatten(Curves); disabled
area = Area(Geometry=surface_split)  # -> Area, Centroid; disabled
list_item = ListItem(List=surface_split, Index=Slider(3, range=0..3), Wrap=True)  # disabled
merge = Merge()  # disabled
pack_objects = PackObjects(X=1, Y=1, Tolerabce=0)  # -> Geo, Transformation; disabled
area_2 = Area(Geometry=curve_2)  # -> Area, Centroid; disabled
division = Division(A=area.Area, B=number_slider_6)  # disabled
diamond_panels = DiamondPanels(Surface=stream_gate.Target1, UDivisions=number_slider_4, VDivisions=number_slider_3)  # -> DiamondPanels, TriPanels
quad_panels = QuadPanels(Surface=stream_gate.Target2, UDivisions=number_slider_4, VDivisions=number_slider_3)
triangular_panels_a = TriangularPanelsA(Surface=stream_gate.Target3, UDivisions=number_slider_4, VDivisions=number_slider_3)
import_image = ImportImage(File="C:\Users\ewama\Documents\GitHub\hgh\img\mozaika_kwantyzacja_ps.png", Rectangle=surface_3)
hexagon_cells = HexagonCells(Surface=stream_gate.Target0, UDivisions=number_slider_4, VDivisions=number_slider_3, TParameter=0.25)  # -> HexagonCells, Centers
populate_geometry = PopulateGeometry(Geometry=surface_split, Count=division, Seed=number_slider_5)  # disabled
panel = Panel(division)  # disabled
vector_2pt = Vector2Pt(PointA=area_2.Centroid, PointB=populate_geometry, Unitize=False)  # -> Vector, Length; disabled
panel_2 = Panel(surface_split)  # disabled
number_slider_7 = Slider(183, range=0..360)  # disabled
merge_2 = Merge(Data1=hexagon_cells.HexagonCells, Data2=diamond_panels.DiamondPanels, Data3=quad_panels, Data4=triangular_panels_a)
move = Move(Geometry=curve_2, Motion=vector_2pt.Vector)  # -> Geometry, Transform; disabled
area_3 = Area(Geometry=move.Geometry)  # -> Area, Centroid; disabled
area_4 = Area(Geometry=merge_2)  # -> Area, Centroid
rotate = Rotate(Geometry=move.Geometry, Angle=degrees(number_slider_7), Plane=area_3.Centroid)  # -> simplify(Geometry), Transform; disabled
panel_3 = Panel(rotate.Geometry)  # disabled
mesh_closest_point = MeshClosestPoint(Point=area_4.Centroid, Mesh=import_image)  # -> Point, Index, Parameter
colour_swatch = ColourSwatch(SwatchColor=RGB(255, 255, 255))
boundary_surfaces_2 = BoundarySurfaces(Edges=merge_2)
curvecollide = CurveCollide(Curves=rotate.Geometry, BasePlane=PlaneXY(0, 0, 0), Strength=1)  # -> Goal, Frames; disabled
mesh_eval = MeshEval(Mesh=import_image, Parameter=mesh_closest_point.Parameter)  # -> Point, Normal, Colour
show = Show()  # disabled
ghpython_script = GhPythonScript(RGB_Color=mesh_eval.Colour)  # -> out, C, M, Y, K
# ---------- ghpython_script: Python ----------
__author__ = "ewama"
__version__ = "2026.05.30"

import rhinoscriptsyntax as rs


# Inputs: RGB_Color (Type Hint: Color)

# 1. Normalize RGB to 0-1 range
r = RGB_Color.R / 255.0
g = RGB_Color.G / 255.0
b = RGB_Color.B / 255.0

# 2. Calculate Black (K)
k = 1.0 - max(r, g, b)

# 3. Calculate Cyan, Magenta, Yellow
if k == 1.0:
    # Pure black layout
    c = 0.0
    m = 0.0
    y = 0.0
else:
    c = (1.0 - r - k) / (1.0 - k)
    m = (1.0 - g - k) / (1.0 - k)
    y = (1.0 - b - k) / (1.0 - k)

# Outputs (Multiply by 100 if you want percentage values)
C = round(c * 100, 1)
M = round(m * 100, 1)
Y = round(y * 100, 1)
K = round(k * 100, 1)
# ---------- end ghpython_script ----------
boolean_toggle_2 = BooleanToggle(False)  # disabled
button_3 = Button()  # disabled
merge_3 = Merge(Data1=show, Data2=curvecollide.Goal)  # disabled
custom_preview = CustomPreview(Geometry=boundary_surfaces_2, Material=mesh_eval.Colour)
colour_cmyk = ColourCMYK(Cyan=ghpython_script.C, Magenta=ghpython_script.M, Yellow=ghpython_script.Y, Key=ghpython_script.K)
bouncysolver = BouncySolver(GoalObjects=merge_3, Reset=button_3, Threshold=1e-15, Tolerance=0.0001, Damping=0.99, Iterations=10, On=boolean_toggle_2)  # -> I, V, O; disabled
geometry = Geometry(bouncysolver.V)  # disabled
panel_4 = Panel(colour_cmyk)
